# Grasshopper definition Combined.gh (Grasshopper 0.9.76)
# plug-ins: Badger

panel = Panel("Flows")
panel_2 = Panel("Plants")
panel_3 = Panel("Floods")

month = Slider(1, range=1..12)
day = Slider(1, range=1..31)
month_2 = Slider(1, range=1..12)
day_2 = Slider(1, range=1..31)
file = ReadFile(File="C:\Users\Philip\Documents\badger\Examples\Combined.csv", PerLineParse=True)
crv = Curve(<curve referenced from the Rhino model>)
pgeneric = GenericPlantAttributesSimulator()  # -> Plants, GrassP, TreeP
planted_date = ConstructDate(Year=Slider(2015, range=2015..2100), Month=month, Day=day, Hour=12, Minute=0, Second=0)
simulated_date = ConstructDate(Year=Slider(2016, range=2014..2100), Month=month_2, Day=day_2, Hour=12, Minute=0, Second=0)
pimport = PlantAttributeImporter()
boundary = BoundarySurfaces(Edges=crv)
placer = PlantPlacementSolver(Plants=pgeneric.Plants, Area=boundary)  # -> Plants, Locations
placer_2 = PlantPlacementSolver(Plants=pimport, Area=boundary)  # -> Plants, Locations
grower = PlantGrowthSimulator(Plants=placer_2.Plants, End=simulated_date, Start=planted_date)  # -> Plants, Grown
grower_2 = PlantGrowthSimulator(Plants=placer.Plants, End=simulated_date, Start=planted_date)  # -> Plants, Grown
shower = PlantAppearanceSimulator(Plants=grower.Plants, Visualisations=False)  # -> Trunk, Root, Crown, Spacing
shower_2 = PlantAppearanceSimulator(Plants=grower_2.Plants, Visualisations=False)  # -> Trunk, Root, Crown, Spacing

number_slider = Slider(50, range=0..100)
srf = Surface(<surface referenced from the Rhino model>)
sdivide = DivideSurface(Surface=srf, UCount=Slider(7, range=0..10), VCount=Slider(30, range=0..100))  # -> flatten(Points), Normals, Parameters

c_script = CSharpScript(fileContents=file)  # -> out, A; inputs fileContents: list of String
# ---------- c_script: C# ----------
    string[] headers = fileContents[0].Split(",".ToCharArray(), StringSplitOptions.RemoveEmptyEntries);
    Print("{0} {1}", fileContents[0], headers.Length);
      
    for (int loopCount = 1; loopCount < fileContents.Count; loopCount++) {
      string[] plant = fileContents[loopCount].Split(",".ToCharArray(), StringSplitOptions.RemoveEmptyEntries);
      Print("{0} {1}", fileContents[loopCount], loopCount);
    }
# ---------- c_script: C# additional code ----------
  class PlantSpecies
  {

    // Naming
    //private String speciesName;
    //private String commonName;
    //private String indigenousName;
    //
    // Lifespan
    //private double timetoMaturity;
    //private double deathRate;
    //
    // Placement
    //private double relativeDistribution;
    //private double requiredSpacingRadius;
    //private double cost;
    //
    // Form
    //private double initialCrownRadius;
    //private double matureCrownRadius;
    //private double varianceCrownRadius;
    //
    //private double initialRootRadius;
    //private double matureRootRadius;
    //private double varianceRootRadius;
    //
    //private double initialHeight;
    //private double matureHeight;
    //private double varianceHeightRadius;
    //
    //private double initialTrunkRadius;
    //private double matureTrunkRadius;
    //private double varianceTrunkRadius;
    //
    // Aesthetics
    //private int displayR;
    //private int displayG;
    //private int displayB;

  }
# ---------- end c_script ----------
panel_4 = Panel(c_script.out)
crv_2 = Curve()
preview = CustomPreview(
    Geometry=crv_2,
    Shader={ambient=RGB(0, 0, 0), diffuse=RGB(255, 105, 180), emission=RGB(76, 32, 54), shine=0.5, specular=RGB(255, 255, 255), transparency=0})

colour = ColourPicker(PickedColour=RGBA(255, 0, 255, 106))
colour_2 = ColourPicker(PickedColour=RGBA(0, 255, 255, 105))
colour_3 = ColourPicker(PickedColour=RGBA(0, 119, 255, 107))
panel_5 = Panel("Colours")
colour_4 = ColourPicker(PickedColour=RGBA(67, 117, 255, 105))

coast = Curve(<curve referenced from the Rhino model>)
construct_point = ConstructPoint(XCoordinate=Slider(0, range=-100000..0), YCoordinate=Slider(0, range=-1000..10000), ZCoordinate=0)
number_slider_2 = Slider(10000, range=0..100000)
panel_6 = Panel("Testing Area")
frontline = Curve(coast)
y_size = Number(number_slider_2)
x_size = Number(number_slider_2)
origin = Point(construct_point)

terrain = Brep(<brep referenced from the Rhino model>)

panel_7 = Panel("High Tide Data")
mean_high_water_springs = Slider(1000, range=0..5000)
mean_high_water_neaps = Slider(1450, range=0..5000)
mean_low_water_neaps = Slider(700, range=0..5000)
mean_low_water_springs = Slider(430, range=0..5000)
mean_sea_level = Slider(0, range=0..5000)

panel_8 = Panel("Site Data")
sea_level_rise_year = Slider(1.6, range=0..5)
storm_surge_height = Slider(500, range=0..5000)
sea_datum_z = Slider(0, range=-3000..3000)
year = Slider(2068, range=2015..2115)

terrain_2 = Brep(terrain)

origin_2 = Point(origin)
num = Number(sea_datum_z)
x_size_2 = Number(x_size)
y_size_2 = Number(y_size)
num_2 = Number(year)
num_3 = Number(mean_high_water_springs)
num_4 = Number(mean_low_water_springs)
num_5 = Number(sea_level_rise_year)
num_6 = Number(mean_sea_level)
num_7 = Number(mean_high_water_neaps)
num_8 = Number(mean_low_water_neaps)
num_9 = Number(storm_surge_height)
mean_high_water_spring = Geometry()
mean_high_water_neap = Geometry()
mean_low_water_spring = Geometry()
mean_low_water_neap = Geometry()
storm_surge_level = Geometry()
mean_sea_level_2 = Geometry()

mean_high_water_spring_2 = Geometry(mean_high_water_spring)
mean_high_water_neap_2 = Geometry(mean_high_water_neap)
mean_low_water_spring_2 = Geometry(mean_low_water_spring)
mean_low_water_neap_2 = Geometry(mean_low_water_neap)
storm_surge_level_2 = Geometry(storm_surge_level)
mean_sea_level_3 = Geometry(mean_sea_level_2)
frontline_2 = Curve(frontline)
terrain_3 = Brep(terrain_2)
cluster = Cluster(level=mean_sea_level_3, frontline=frontline_2, terrain=terrain_3)  # -> curve_3, list
cluster_2 = Cluster(level=mean_low_water_neap_2, frontline=frontline_2, terrain=terrain_3)  # -> curve_3, list
cluster_3 = Cluster(level=storm_surge_level_2, frontline=frontline_2, terrain=terrain_3)  # -> curve_3, list
cluster_4 = Cluster(level=mean_high_water_neap_2, frontline=frontline_2, terrain=terrain_3)  # -> curve_3, list
cluster_5 = Cluster(level=mean_low_water_spring_2, frontline=frontline_2, terrain=terrain_3)  # -> curve_3, list
cluster_6 = Cluster(level=mean_high_water_spring_2, frontline=frontline_2, terrain=terrain_3)  # -> curve_3, list
mean_sea_level_srf = CustomPreview(Geometry=cluster.list, Shader=colour_3)
mean_sea_level_srf_2 = CustomPreview(Geometry=cluster_2.list, Shader=colour_3)
mean_sea_level_srf_3 = CustomPreview(Geometry=cluster_4.list, Shader=colour_3)
mean_sea_level_srf_4 = CustomPreview(Geometry=cluster_5.list, Shader=colour_3)
mean_sea_level_srf_5 = CustomPreview(Geometry=cluster_6.list, Shader=colour_3)
mean_sea_level_srf_6 = CustomPreview(Geometry=cluster_3.list, Shader=colour_3)
mean_sea_level_crv = CustomPreview(Geometry=cluster.curve_3, Shader=colour_3)
mean_sea_level_crv_2 = CustomPreview(Geometry=cluster_2.curve_3, Shader=colour_3)
mean_sea_level_crv_3 = CustomPreview(Geometry=cluster_4.curve_3, Shader=colour_3)
mean_sea_level_crv_4 = CustomPreview(Geometry=cluster_5.curve_3, Shader=colour_3)
mean_sea_level_crv_5 = CustomPreview(Geometry=cluster_6.curve_3, Shader=colour_3)
mean_sea_level_crv_6 = CustomPreview(Geometry=cluster_3.curve_3, Shader=colour_3)

# ==== cluster Cluster
level = ClusterInput()
frontline = ClusterInput()
terrain = ClusterInput()
level_2 = Brep(level)
terrain_2 = Brep(terrain)
bbx = BrepBrep(BrepA=terrain_2, BrepB=level_2)  # -> Curves, Points
find_closest = FindClosest(curve=bbx.Curves, curve_2=frontline)
split_with_brep = SplitWithBrep(Curve=level_2, Brep=terrain_2)  # -> Curve, Points
find_closest_2 = FindClosest(curve=split_with_brep.Curve, curve_2=frontline)
curve = Curve(find_closest)
list_item = ListItem(List=find_closest_2, Index=1, Wrap=True)
join_curves = JoinCurves(Curves=[curve, list_item], Preserve=False)
boundary_surfaces = BoundarySurfaces(Edges=join_curves)
list_length = ListLength(List=bbx.Curves)
larger_than = LargerThan(FirstNumber=list_length, SecondNumber=0)  # -> LargerThan, OrEqualTo
cull_pattern = CullPattern(List=boundary_surfaces, CullPattern=larger_than.LargerThan)
curve_2 = Curve(find_closest)
curve_3 = ClusterOutput(curve_2)
list = ClusterOutput(cull_pattern)

# ==== cluster FindClosest
curve = ClusterInput()
curve_2 = ClusterInput()
divide_curve = DivideCurve(Curve=curve_2, Count=2, Kinks=False)  # -> Points, Tangents, Parameters
divide_curve_2 = DivideCurve(Curve=curve, Count=2, Kinks=False)  # -> Points, Tangents, Parameters
list_item = ListItem(List=divide_curve_2.Points, Index=1, Wrap=True)  # -> flatten(Item)
list_item_2 = ListItem(List=divide_curve.Points, Index=1, Wrap=True)
distance = Distance(PointA=list_item, PointB=list_item_2)
sort_list = SortList(Keys=distance)  # -> Keys, ValuesValuesA
list_item_3 = ListItem(List=sort_list.Keys, Index=0, Wrap=True)
member_index = MemberIndex(Set=distance, Member=list_item_3)  # -> Index, Count
list_item_4 = ListItem(List=curve, Index=member_index.Index, Wrap=True)
i = ClusterOutput(list_item_4)
