# Grasshopper definition Groundhog - Terrain Examples.ghx (Grasshopper 0.9.76)
# plug-ins: Groundhog

# ---- group: Assume North = y axis
Y = UnitY(Factor="1")

# ----
# Groundhog Example File
# Definition prepared for Groundhog v0.7.0b and depends on components from that plugin. It is available for download at http://groundhog.la/
# 
# Contact groundhog@philipbelesky.com for support or feedback.
# 
# This is an example .3dm file related to the plugin's documentation.
# 
# This definition is licensed under the terms of the GPL v3 https://opensource.org/licenses/GPL-3.0
base_contour_curves = Curve([<curve referenced from the Rhino model> x69])

base_terrain_mesh = Mesh(<mesh referenced from the Rhino model>)
aspect_angle = Vector(Y)

# ---- group: Convert contours to a mesh
cp = ControlPoints(Curve=base_contour_curves)  # -> Points, Weights, Knots
remove_overlapping = RemoveOverlapping(pt=flatten(cp.Points))
del = DelaunayMesh(Points=remove_overlapping, Plane=PlaneXY(0, 0, 0))

# ---- group: Calculate grade from mesh faces
slope = MeshSlope(Mesh=del)  # -> MeshFaces, FaceCenters, FaceSlopeVectors, FaceSlopeAngles

# ---- group: Calculate aspect from mesh faces
aspect = MeshAspect(Mesh=base_terrain_mesh, Aspect=aspect_angle)  # -> MeshFaces, FaceCenters, FaceAspectAngles

# ---- group: Visualise grade on mesh faces
mesh = Mesh(slope.MeshFaces)
angles = Integer(slope.FaceSlopeAngles)
bnd = Bounds(Numbers=angles)
gradient = Gradient(LowerLimit=0, UpperLimit=bnd, Parameter=angles, stops=[0: RGB(255, 255, 255), 1: RGB(0, 0, 0)])
mcol = MeshColours(Mesh=simplify(graft(mesh)), Colours=simplify(graft(gradient)))

# ---- group: Visualise grade direction
face_centers = Point(slope.FaceCenters)
face_vectors = Vector(slope.FaceSlopeVectors)
vector_length = Slider(0.5, range=0..2)
text_vector_color = ColourSwatch(SwatchColor=RGB(255, 0, 255))
multiplication = Multiplication(A=face_vectors, B=vector_length)
angles_vectors = VectorDisplayEx(Point=face_centers, Vector=multiplication, Colour=text_vector_color, Width=1)

# ---- group: Visualise aspect as solid gradient
mesh_2 = Mesh(aspect.MeshFaces)
angles_2 = Integer(aspect.FaceAspectAngles)
blur_iterations = Slider(0.3, range=0.2..2)
bnd_2 = Bounds(Numbers=angles_2)
gradient_2 = Gradient(
    LowerLimit=0,
    UpperLimit=bnd_2,
    Parameter=angles_2,
    stops=[0: RGB(255, 0, 0), 0.254: RGB(233, 136, 0), 0.5: RGB(254, 244, 84), 0.751: RGB(234, 126, 0), 1: RGB(255, 0, 0)])
mcol_2 = MeshColours(Mesh=simplify(graft(mesh_2)), Colours=simplify(graft(gradient_2)))
mjoin = MeshJoin(Meshes=flatten(mcol_2))
weld = WeldMesh(Mesh=mjoin, Angle=3.141592654)
mblur = BlurMesh(Mesh=weld, Iterations=blur_iterations)

# ---- group: Label aspects within specified range
face_centers_2 = Point(aspect.FaceCenters)
face_angles = Integer(aspect.FaceAspectAngles)
cutoff_b = Slider(120, range=0..360)
cutoff_a = Slider(180, range=0..360)
text_size = Slider(250, range=0..1000)
text_vector_color_2 = ColourSwatch(SwatchColor=RGB(0, 0, 0))
dom = ConstructDomain(DomainStart=cutoff_b, DomainEnd=cutoff_a)
inc = Includes(Value=face_angles, Domain=dom)  # -> Includes, Deviation
cull = CullPattern(List=face_centers_2, CullPattern=inc.Includes)
cull_2 = CullPattern(List=face_angles, CullPattern=inc.Includes)
angles_labels = TextTag3D(Location=cull, Text=cull_2, Size=text_size, Colour=text_vector_color_2, Justification=5)

# ==== cluster RemoveOverlapping
pt = ClusterInput()
pt_2 = Point(pt)
sort_pt = SortPoints(Points=pt_2)  # -> Points, Indices
shift = ShiftList(List=sort_pt.Points, Shift=1, Wrap=True)
pdecon = Deconstruct(Point=shift)  # -> XComponent, YComponent, ZComponent
pdecon_2 = Deconstruct(Point=sort_pt.Points)  # -> XComponent, YComponent, ZComponent
equals = Equality(FirstNumber=pdecon_2.YComponent, SecondNumber=pdecon.YComponent)  # -> Equality, Inequality
equals_2 = Equality(FirstNumber=pdecon_2.XComponent, SecondNumber=pdecon.XComponent)  # -> Equality, Inequality
and = GateAnd(A=equals_2.Equality, B=equals.Equality)
equals_3 = Equality(FirstNumber=and, SecondNumber=0)  # -> Equality, Inequality
cull = CullPattern(List=sort_pt.Points, CullPattern=equals_3.Equality)
pt_3 = Point(cull)
pt_4 = ClusterOutput(pt_3)
