# Grasshopper definition Groundhog - Max IV Laboratory.ghx (Grasshopper 0.9.76)

# ----
# Groundhog Project File
# Definition prepared for Groundhog v0.7.1b and depends on components from that plugin. It is available for download at http://groundhog.la/
# 
# Contact groundhog@philipbelesky.com for support or feedback
# 
# This definition is hosted, along with reference materials, at http://127.0.0.1:4000/projects/max-iv-laboratory
# 
# This definition is licensed under the terms of the GPL v3 https://opensource.org/licenses/GPL-3.0
center_point = Point(<point referenced from the Rhino model>)

circle_cnr = CircleCNR(Center=center_point, Normal=Vector(0, 0, 1), Radius=Slider(110000, range=0..1000000))

# ---- group: Straight tangents
radians = Radians(Degrees=Slider(194, range=0..360))
divide_curve = DivideCurve(Curve=circle_cnr, Count=Slider(40, range=0..100), Kinks=False)  # -> Points, Tangents, Parameters
xy_plane = XYPlane(Origin=Point(0, 0, 0))
rotate = Rotate(Vector=divide_curve.Tangents, Axis=xy_plane, Angle=radians)
multiplication = Multiplication(A=rotate, B=Slider(400000, range=100000..400000))
move = Move(Geometry=divide_curve.Points, Motion=multiplication)  # -> Geometry, Transform
line = Line(StartPoint=divide_curve.Points, EndPoint=move.Geometry)

# ---- group: Curved Segments
curve_length = Slider(10, range=0..100)
curve_points = Slider(20, range=0..100)
divide_curve_2 = DivideCurve(Curve=circle_cnr, Count=Slider(32, range=0..100), Kinks=False)  # -> Points, Tangents, Parameters
construct_domain = ConstructDomain(DomainStart=0, DomainEnd=curve_length)
range = Range(Domain=construct_domain, Steps=curve_points)
graph_mapper = GraphMapper(
    range,
    x0=0,
    x1=10,
    y0=0,
    y1=2,
    container_name="Bezier",
    cpx=[0, 0.1810597032, 0.5611973405, 1],
    cpy=[0, 0.8286336064, 0.8465806842, 0.5773736835])
origin = Point(graft(divide_curve_2.Points))
vector = Vector(graft(divide_curve_2.Tangents))
multiplication_2 = Multiplication(A=graph_mapper, B=-1)
scaling = Slider(46241, range=0..100000)
vector_xyz = VectorXYZ(XComponent=range, YComponent=multiplication_2, ZComponent=0)  # -> Vector, Length
multiplication_3 = Multiplication(A=vector_xyz.Vector, B=scaling)
xy_plane_2 = XYPlane(Origin=origin)
move_2 = Move(Geometry=origin, Motion=multiplication_3)  # -> Geometry, Transform
align_plane = AlignPlane(Plane=xy_plane_2, Direction=vector)  # -> Plane, Angle
interpolate = Interpolate(Vertices=move_2.Geometry, Degree=3, Periodic=False, KnotStyle=1)  # -> Curve, Length, Domain
subtraction = Subtraction(A=align_plane.Angle, B=Slider(5.8, range=0..10))
rotate_2 = Rotate(Geometry=interpolate.Curve, Angle=subtraction, Plane=align_plane.Plane)  # -> Geometry, Transform

# ---- group: Trim to Boundary
straight_tangents = Curve(line)
site_bounds = Curve(<curve referenced from the Rhino model>)
curved_tangents = Curve(rotate_2.Geometry)
curve_curve = CurveCurve(CurveA=site_bounds, CurveB=curved_tangents)  # -> Points, ParamsA, ParamsB
curve_curve_2 = CurveCurve(CurveA=site_bounds, CurveB=straight_tangents)  # -> Points, ParamsA, ParamsB
sub_curve = SubCurve(BaseCurve=graft(straight_tangents), Domain=curve_curve_2.ParamsB)
sub_curve_2 = SubCurve(BaseCurve=graft(curved_tangents), Domain=curve_curve.ParamsB)
straight_tangents_2 = Curve(sub_curve)
curved_tangents_2 = Curve(sub_curve_2)

# ----
number_slider = Slider(22, range=0..100)
divide_curve_3 = DivideCurve(Curve=straight_tangents_2, Count=number_slider, Kinks=False)  # -> Points, Tangents, Parameters
deconstruct = Deconstruct(Point=divide_curve_3.Points)  # -> XComponent, YComponent, ZComponent
repeat_data = RepeatData(Data=[Slider(0, range=0..1000), Slider(4500, range=0..10000)], Length=number_slider)
construct_point = ConstructPoint(XCoordinate=deconstruct.XComponent, YCoordinate=deconstruct.YComponent, ZCoordinate=repeat_data)
# This part of the definition is still to be completed. The different tangent curves need to be assembled into a surface and then draining simulations and planting distribution performed. Kangaroo-based simulations of the acoustic spread may also be added.
nurbs_curve = NurbsCurve(Vertices=construct_point, Degree=3, Periodic=False)  # -> Curve, Length, Domain

number_slider_2 = Slider(22, range=0..100)
divide_curve_4 = DivideCurve(Curve=curved_tangents_2, Count=number_slider_2, Kinks=False)  # -> Points, Tangents, Parameters
deconstruct_2 = Deconstruct(Point=divide_curve_4.Points)  # -> XComponent, YComponent, ZComponent
repeat_data_2 = RepeatData(Data=[Slider(0, range=0..1000), Slider(4500, range=0..10000)], Length=number_slider_2)
construct_point_2 = ConstructPoint(XCoordinate=deconstruct_2.XComponent, YCoordinate=deconstruct_2.YComponent, ZCoordinate=repeat_data_2)
nurbs_curve_2 = NurbsCurve(Vertices=construct_point_2, Degree=3, Periodic=False)  # -> Curve, Length, Domain
