# Grasshopper definition Groundhog - South Park.ghx (Grasshopper 0.9.76)

curve = Curve([<curve referenced from the Rhino model> x13])
curve_2 = Curve([<curve referenced from the Rhino model> x7])
curve_3 = Curve([<curve referenced from the Rhino model> x6])
curve_4 = Curve([<curve referenced from the Rhino model> x6])
curve_5 = Curve([<curve referenced from the Rhino model> x7])
small_attractors = Curve(graft(curve_5))
big_attractors = Curve(graft(curve_4))
all_attractors = Curve(graft(curve))
g_bed_boundary = Curve(<curve referenced from the Rhino model>)
park_boundary = Curve(<curve referenced from the Rhino model>)
planting_csv = FilePath("C:\Users\runra\Dropbox\Groundhog Supporting\Projects models (future)\south-park\South Park-Garden Beds.csv")
nw_attractors = Curve(curve_2)
se_attractors = Curve(curve_3)
path_base = Curve(<curve referenced from the Rhino model>)
g_bed_edge = Curve([<curve referenced from the Rhino model> x2])

pull_res_garden = Slider(14, range=0..1000)
garden_pull_strength = Slider(6242, range=0..100000)
paver_fillet_radius = Slider(1000, range=0..1000)
garden_bed_size = Slider(5128, range=0..100000)
paver_width = Slider(900, range=0..1000)
pull_res_1 = Slider(150, range=0..1000)
pull_res_2 = Slider(150, range=0..1000)
pull_res_3 = Slider(150, range=0..1000)
pull_strength_1 = Slider(9000, range=0..100000)
pull_strength_2 = Slider(3043, range=0..100000)
path_width = Slider(4000, range=0..10000)
paver_count = Slider(143, range=0..1000)

# ---- group: STEP 1: INTERPOLATING
# Groundhog Project File
# This Grasshopper definition and its corresponding Rhinoceros model were developed by Albert Rex and Philip Belesky as part of the Groundhog project.
# 
# The definition and model are provided as speculative reverse-engineerings of how this landscape project could have been (partly) designed using computational methods. More information available at https://www.groundhog.la/projects/south-park/
# 
# This definition depends on components from version v0.9.1b of the Groundhog plugin. It is available for download at http://groundhog.la/plugin/
# 
# This definition is licensed under the terms of the GPL v3 https://opensource.org/licenses/GPL-3.0
# This first section of the script uses data from site to interpolate a line through the park pulled toward these data points according to their importance.
area = Area(Geometry=big_attractors)  # -> Area, flatten(Centroid)
divide_curve = DivideCurve(Curve=path_base, Count=pull_res_1, Kinks=False)  # -> graft(Points), Tangents, Parameters
closest_point = ClosestPoint(Point=divide_curve.Points, Cloud=area.Centroid)  # -> ClosestPoint, CPIndex, Distance
vector_2pt = Vector2Pt(PointA=divide_curve.Points, PointB=closest_point.ClosestPoint, Unitize=False)  # -> Vector, Length
line = Line(StartPoint=divide_curve.Points, EndPoint=closest_point.ClosestPoint)
amplitude = Amplitude(Vector=vector_2pt.Vector, Amplitude=pull_strength_1)
vector_display = VectorDisplay(Anchor=divide_curve.Points, Vector=vector_2pt.Vector)
move = Move(Geometry=divide_curve.Points, Motion=amplitude)  # -> Geometry, Transform
interpolate = Interpolate(Vertices=flatten(move.Geometry), Degree=3, Periodic=False, KnotStyle=1)  # -> Curve, Length, Domain
area_2 = Area(Geometry=small_attractors)  # -> Area, flatten(Centroid)
divide_curve_2 = DivideCurve(Curve=interpolate.Curve, Count=pull_res_2, Kinks=False)  # -> graft(Points), Tangents, Parameters
closest_point_2 = ClosestPoint(Point=divide_curve_2.Points, Cloud=area_2.Centroid)  # -> ClosestPoint, CPIndex, Distance
vector_2pt_2 = Vector2Pt(PointA=divide_curve_2.Points, PointB=closest_point_2.ClosestPoint, Unitize=False)  # -> Vector, Length
line_2 = Line(StartPoint=divide_curve_2.Points, EndPoint=closest_point_2.ClosestPoint)
vector_display_2 = VectorDisplay(Anchor=divide_curve_2.Points, Vector=vector_2pt_2.Vector)
amplitude_2 = Amplitude(Vector=vector_2pt_2.Vector, Amplitude=pull_strength_2)
move_2 = Move(Geometry=divide_curve_2.Points, Motion=amplitude_2)  # -> Geometry, Transform
interpolate_2 = Interpolate(Vertices=flatten(move_2.Geometry), Degree=3, Periodic=False, KnotStyle=1)  # -> Curve, Length, Domain
interpolated_data_line = Curve(interpolate_2.Curve)
big_attractor_lines = Line(line)

# ----
# Divides remaining area into Garden Beds and Lawns. Garden bed area is also determined by initial input data
area_3 = Area(Geometry=all_attractors)  # -> Area, flatten(Centroid)
divide_curve_3 = DivideCurve(Curve=g_bed_edge, Count=pull_res_garden, Kinks=False)  # -> graft(Points), Tangents, Parameters
closest_point_3 = ClosestPoint(Point=divide_curve_3.Points, Cloud=area_3.Centroid)  # -> ClosestPoint, CPIndex, Distance
vector_2pt_3 = Vector2Pt(PointA=divide_curve_3.Points, PointB=closest_point_3.ClosestPoint, Unitize=False)  # -> Vector, Length
line_3 = Line(StartPoint=divide_curve_3.Points, EndPoint=closest_point_3.ClosestPoint)
vector_display_3 = VectorDisplay(Anchor=divide_curve_3.Points, Vector=vector_2pt_3.Vector)
amplitude_3 = Amplitude(Vector=vector_2pt_3.Vector, Amplitude=garden_bed_size)
negative = Negative(Value=amplitude_3)
move_3 = Move(Geometry=divide_curve_3.Points, Motion=negative)  # -> Geometry, Transform
point_in_curve = PointInCurve(Point=flatten(move_3.Geometry), Curve=g_bed_boundary)  # -> Relationship, Point
equality = Equality(FirstNumber=point_in_curve.Relationship, SecondNumber=2)  # -> Equality, Inequality
dispatch = Dispatch(List=flatten(move_3.Geometry), DispatchPattern=flatten(equality.Equality))  # -> ListA, ListB
unit_y = UnitY(Factor=garden_pull_strength)
interpolate_3 = Interpolate(Vertices=flatten(dispatch.ListA), Degree=3, Periodic=False, KnotStyle=1)  # -> Curve, Length, Domain
interpolate_4 = Interpolate(Vertices=flatten(dispatch.ListB), Degree=3, Periodic=False, KnotStyle=1)  # -> Curve, Length, Domain
end_points = EndPoints(Curve=interpolate_3.Curve)  # -> Start, End
end_points_2 = EndPoints(Curve=interpolate_4.Curve)  # -> Start, End
negative_2 = Negative(Value=unit_y)
move_4 = Move(Geometry=end_points.Start, Motion=unit_y)  # -> Geometry, Transform
move_5 = Move(Geometry=end_points.End, Motion=unit_y)  # -> Geometry, Transform
move_6 = Move(Geometry=end_points_2.Start, Motion=negative_2)  # -> Geometry, Transform
move_7 = Move(Geometry=end_points_2.End, Motion=negative_2)  # -> Geometry, Transform
line_4 = Line(StartPoint=move_4.Geometry, EndPoint=move_5.Geometry)
line_5 = Line(StartPoint=move_6.Geometry, EndPoint=move_7.Geometry)
end_points_3 = EndPoints(Curve=line_4)  # -> Start, End
end_points_4 = EndPoints(Curve=line_5)  # -> Start, End
line_6 = Line(StartPoint=end_points_4.Start, EndPoint=end_points_2.Start)
line_7 = Line(StartPoint=end_points_2.End, EndPoint=end_points_4.End)
line_8 = Line(StartPoint=end_points_3.Start, EndPoint=end_points.Start)
line_9 = Line(StartPoint=end_points.End, EndPoint=end_points_3.End)
join_curves = JoinCurves(Curves=[interpolate_3.Curve, line_8, line_9, line_4], Preserve=False)
join_curves_2 = JoinCurves(Curves=[line_6, line_7, interpolate_4.Curve, line_5], Preserve=False)

medium_attractor_lines = Line(line_2)

# ---- group: STEP 2: OFFSETING
# This second step generates offsets from the intial line that will inform the extents (y) of our path. These offsets are also influenced by the input data.
deconstruct_arc = DeconstructArc(Arc=nw_attractors)  # -> BasePlane, Radius, Angle
divide_curve_4 = DivideCurve(Curve=interpolated_data_line, Count=pull_res_3, Kinks=False)  # -> graft(Points), Tangents, Parameters
deconstruct_arc_2 = DeconstructArc(Arc=se_attractors)  # -> BasePlane, Radius, Angle
closest_point_4 = ClosestPoint(Point=divide_curve_4.Points, Cloud=deconstruct_arc.BasePlane)  # -> ClosestPoint, CPIndex, Distance
closest_point_5 = ClosestPoint(Point=divide_curve_4.Points, Cloud=deconstruct_arc_2.BasePlane)  # -> ClosestPoint, CPIndex, Distance
vector_2pt_4 = Vector2Pt(PointA=divide_curve_4.Points, PointB=[closest_point_4.ClosestPoint, closest_point_5.ClosestPoint], Unitize=False)  # -> Vector, Length
line_10 = Line(StartPoint=divide_curve_4.Points, EndPoint=[closest_point_4.ClosestPoint, closest_point_5.ClosestPoint])
amplitude_4 = Amplitude(Vector=vector_2pt_4.Vector, Amplitude=path_width)
vector_display_4 = VectorDisplay(Anchor=divide_curve_4.Points, Vector=vector_2pt_4.Vector)
move_8 = Move(Geometry=divide_curve_4.Points, Motion=amplitude_4)  # -> Geometry, Transform
dispatch_2 = Dispatch(List=flatten(move_8.Geometry), DispatchPattern=[True, False])  # -> ListA, reverse(ListB)
interpolate_5 = Interpolate(Vertices=[dispatch_2.ListA, dispatch_2.ListB], Degree=3, Periodic=True, KnotStyle=1)  # -> Curve, Length, Domain
unit_z = UnitZ(Factor=1)
boundary_surfaces = BoundarySurfaces(Edges=interpolate_5.Curve)
offset_attractor_lines = Line(line_10)
extrude = Extrude(Base=boundary_surfaces, Direction=unit_z)
boundary_area_of_path = Brep(boundary_surfaces)

# ---- group: STEP 3: PAVING
# Here we use the lines generated in step 1 and 2 to produce a detailed paving system which is responsive to changes in data input.
_10000 = Integer(10000)
divide_curve_5 = DivideCurve(Curve=path_base, Count=paver_count, Kinks=False)  # -> graft(Points), Tangents, Parameters
unit_y_2 = UnitY(Factor=_10000)
negative_3 = Negative(Value=unit_y_2)
move_9 = Move(Geometry=divide_curve_5.Points, Motion=unit_y_2)  # -> Geometry, Transform
move_10 = Move(Geometry=divide_curve_5.Points, Motion=negative_3)  # -> Geometry, Transform
line_11 = Line(StartPoint=move_9.Geometry, EndPoint=move_10.Geometry)  # -> flatten(Line)
boundary_area_of_path_3d = Brep(extrude)
paver_start_line = Line(line_11)
trim_with_brep = TrimWithBrep(Curve=paver_start_line, Brep=boundary_area_of_path_3d)  # -> Inside, Outside
unit_x = UnitX(Factor=paver_width)
move_11 = Move(Geometry=trim_with_brep.Inside, Motion=unit_x)  # -> Geometry, Transform
end_points_5 = EndPoints(Curve=trim_with_brep.Inside)  # -> Start, End
end_points_6 = EndPoints(Curve=move_11.Geometry)  # -> Start, End
line_12 = Line(StartPoint=end_points_6.Start, EndPoint=end_points_5.Start)
line_13 = Line(StartPoint=end_points_6.End, EndPoint=end_points_5.End)
join_curves_3 = JoinCurves(Curves=[line_12, line_13, move_11.Geometry, trim_with_brep.Inside], Preserve=False)  # -> flatten(Curves)
fillet = Fillet(Curve=join_curves_3, Radius=paver_fillet_radius)
trim_with_region = TrimWithRegion(Curve=fillet, Region=park_boundary)  # -> Inside, flatten(Outside)

# ----
# Subracts paved area of park from remaining area.
region_difference = RegionDifference(CurvesA=park_boundary, CurvesB=boundary_area_of_path)  # -> flatten(Result)

region_intersection = RegionIntersection(CurvesA=region_difference, CurvesB=join_curves)
region_intersection_2 = RegionIntersection(CurvesA=region_difference, CurvesB=join_curves_2)
region_difference_2 = RegionDifference(CurvesA=region_difference, CurvesB=join_curves)

big_attractor_lines_2 = Line(big_attractor_lines)
medium_attractor_lines_2 = Line(medium_attractor_lines)
offset_attractor_lines_2 = Line(offset_attractor_lines)
all_attractor_lines = Line([big_attractor_lines_2, medium_attractor_lines_2, offset_attractor_lines_2])

attractor_lines = Line(all_attractor_lines)
outlines_4_baking = Curve([region_difference_2, region_intersection, region_intersection_2])
path_outline = CustomPreview(Geometry=interpolate_5.Curve, Material=ColourSwatch(SwatchColor=RGB(0, 242, 65)))
pull_directions = CustomPreview(Geometry=attractor_lines, Material=ColourSwatch(SwatchColor=RGB(189, 189, 189)))
path = CustomPreview(Geometry=trim_with_region.Inside, Material=ColourSwatch(SwatchColor=RGB(0, 116, 166)))
divisions = CustomPreview(Geometry=outlines_4_baking, Material=ColourSwatch(SwatchColor=RGB(133, 111, 111)))
